# Grasshopper definition Encoder_V1.gh (Grasshopper 1.0.7)
# plug-ins: Pufferfish

# ---- group: INPUTS
top_layer_thickness = Slider(1.38, range=0..4)
air_gap_thickness = Slider(1.92, range=0..4)
scale_svg = Slider(6.92, range=0..10)
path_to_svg_file = FilePath("C:\Users\takaa\Desktop\InfraredTags_Project\Github\InfraTags\public\encoder\examples\SVGs\Aruco_3.svg")
knob = ControlKnob(Decimals=2, Limit=False, Maximum=10, Minimum=0, Range=6.28, Value=3.14)
path_to_stl = FilePath("C:\Users\takaa\Desktop\InfraredTags_Project\Github\InfraTags\public\encoder\examples\STLs\Mug.STL")
pt = Point(Point(-20, -10, 100))

# ---- group: Mesh_A
c_script = CSharpScript(fileName=path_to_stl)  # -> out, headerText, stlBinaryMesh; inputs fileName: String
# ---------- c_script: C# usings ----------
using System.IO;
# ---------- c_script: C# ----------
    char[] header = null;
    int faces = 0;
    Mesh mesh = new Mesh();
    float nx, ny, nz, vx, vy,vz;
    if (File.Exists(fileName))
    {
      using (BinaryReader reader = new BinaryReader(File.Open(fileName, FileMode.Open)))
      {
        //BINARY STL
        /*
        UINT8[80] – Header
        UINT32 – Number of triangles


        foreach triangle
        REAL32[3] – Normal vector
        REAL32[3] – Vertex 1
        REAL32[3] – Vertex 2
        REAL32[3] – Vertex 3
        UINT16 – Attribute byte count
        end
        */

        header = reader.ReadChars(80);
        faces = reader.ReadInt32();
        //tempDirectory = reader.ReadString();
        //autoSaveTime = reader.ReadInt32();
        //showStatusBar = reader.ReadBoolean();

        for (int i = 0; i < faces; i++)
        {
          nx = reader.ReadSingle();
          ny = reader.ReadSingle();
          nz = reader.ReadSingle();

          mesh.FaceNormals.AddFaceNormal(nx, ny, nz);

          vx = reader.ReadSingle();
          vy = reader.ReadSingle();
          vz = reader.ReadSingle();
          mesh.Vertices.Add(vx, vy, vz);

          vx = reader.ReadSingle();
          vy = reader.ReadSingle();
          vz = reader.ReadSingle();
          mesh.Vertices.Add(vx, vy, vz);

          vx = reader.ReadSingle();
          vy = reader.ReadSingle();
          vz = reader.ReadSingle();
          mesh.Vertices.Add(vx, vy, vz);
          Int16 ii = reader.ReadInt16();

        }
        for (int i = 0; i < faces; i++)
        {
          mesh.Faces.AddFace(i * 3, i * 3 + 1, i * 3 + 2);
        }
      }
    }

    mesh.Normals.ComputeNormals();


    string texte = new string(header);
    stlBinaryMesh = mesh;

    headerText = new string(header);
# ---------- end c_script ----------
python = PythonScript(FILE_PATH=path_to_stl)  # -> out, MESH
# ---------- python: Python ----------
import Rhino

mesh = Rhino.Geometry.Mesh() # Initialize "mesh" variable as a blank mesh object to hold each face.
MESH = Rhino.Geometry.Mesh() # Initialize "MESH" variable as a blank mesh object to accumulate faces.

with open(FILE_PATH) as f:

  for line in f:

    if "vertex" in line:
      q = line.replace("      vertex ", "")
      q = q.replace("\n", "")
      q = [float(x) for x in q.split()]
      mesh.Vertices.Add(q[0],q[1],q[2]) # Fill mesh with three vertex lines in a row.

    if "endloop" in line: # File itself tells us we are done with three vertices for one face.
      mesh.Faces.AddFace(0,1,2) # Create a single face mesh.
      MESH.Append(mesh) # Magically build a real multi-face mesh while removing redundant vertices.
      mesh = Rhino.Geometry.Mesh() # Reinitialize empty mesh object for each mesh face.

  MESH.Normals.ComputeNormals() # Gives nice mesh and preview but makes the script take longer.
# ---------- end python ----------
python_2 = GhPythonScript(MESH_A=c_script.stlBinaryMesh, MESH_B=python.MESH)  # -> out, Valid_Mesh
# ---------- python_2: Python ----------
__author__ = "Ahmad"
__version__ = "2021.06.16"

import rhinoscriptsyntax as rs
A = rs.coercemesh(MESH_A)
B = rs.coercemesh(MESH_B)

if B:
    Valid_Mesh = B
else:
    Valid_Mesh = A
# ---------- end python_2 ----------
mesh = Mesh(python_2.Valid_Mesh)
facen = FaceNormals(Mesh=mesh)  # -> Centers, Normals
find_mesh_centroid = GhPythonScript(Centers=facen.Centers)  # -> Centroid, Origin; inputs Centers: list
# ---------- find_mesh_centroid: Python ----------
"""Provides a scripting component.
    Inputs:
        Centers: all the mesh centers
    Output:
        Centroid: The mesh centroid"""

__author__ = "Ahmad"
__version__ = "2021.06.11"

import rhinoscriptsyntax as rs
import Rhino as rh
pts = rs.coerce3dpointlist(Centers)
sum_x, sum_y, sum_z, len = 0, 0, 0, len(pts)
for pt in pts:
    sum_x += pt.X
    sum_y += pt.Y
    sum_z += pt.Z
#centroid = (sum_x/len, sum_y/len, sum_z/len)
Centroid = rh.Geometry.Point3d(sum_x/len, sum_y/len, sum_z/len)
Origin = rh.Geometry.Point3d(0, 0, 0)
# ---------- end find_mesh_centroid ----------
vec2pt = Vector2Pt(PointA=find_mesh_centroid.Centroid, PointB=find_mesh_centroid.Origin, Unitize=False)  # -> Vector, Length
move = Move(Geometry=mesh, Motion=vec2pt.Vector)  # -> Geometry, Transform
mesh_2 = Mesh(move.Geometry)

# ----
get_normal = GetNormal(point=pt, mesh=mesh_2)
converts_svg_file_to_gh_curve = GhPythonScript(SVG_FILE_PATH=path_to_svg_file)  # -> out, Curve
# ---------- converts_svg_file_to_gh_curve: Python ----------
__author__ = "Ahmad"
__version__ = "2021.06.13"

import rhinoscriptsyntax as rs
import Rhino as rh


"""
Ahmad Taka
6/6/2021
"""
import re


# Utility Functions

def getPaths(svg):
    """
    :param svg: text of svg
    :return: each path dom in text form
    """
    return re.findall("<path .+>", text)


def getAttribute(dom, attribute):
    """
    :param dom: str("<[element] [attribute]="[attribute_content]">)
    :param attribute: str(attribute)
    :return: attribute_content
    """
    return re.search("" + attribute + "=\"(.*?)\"", dom).group().replace("" + attribute + "=", "").replace("\"", "")


def getPolylines(path_dom):
    """
    :param path_dom: str(<path d="[polylines]">)
    :return: polylines
    """
    return getAttribute(path_dom, "d").split()


def getStartingPoint(polyline):
    """
    :param polyline: str(M[path]z)
    :return: starting point of path
    """
    return tuple([float(x) for x in re.search("\d+,\d+", polyline).group().split(",")])


def getPolylinePath(polyline):
    """
    :param polyline: str(Mx,y[other_points]z)
    :return: list(other_points)
    """
    other_points = re.search("M\d+,\d+(.*?)z", polyline).group().translate({ord(i): None for i in 'Mz'})
    other_points = re.sub("\d+,\d+", "", other_points)
    if other_points == 'h1v1h-1':
        x, y = getStartingPoint(polyline)
        return [(x, y), (x + 1, y), (x + 1, y + 1), (x, y + 1)]


class Point2D(object):
    def __init__(self, x, y):
        self.x = x
        self.y = y

    def Translate(self, translation_tuple):
        """
        :param translation_tuple: (+x,  +y)
        :return: translated point
        """
        dx, dy = translation_tuple
        return Point2D(self.x + dx, self.y + dy)

    def Scale(self, scale_tuple):
        """
        :param scale_tuple: (*x, *y)
        :return: scaled point
        """
        Ax, Ay = scale_tuple
        return Point2D(self.x * Ax, self.y * Ay)

    def __repr__(self):
        return "Point2D({},{})".format(self.x, self.y)


if __name__ == "__main__":
    FILE_PATH = SVG_FILE_PATH
    text = open(FILE_PATH).read()
    paths = getPaths(text)
    rhino_paths = []
    for path in paths:
        polylines = getPolylines(path)
        #color = getAttribute(path, "fill")
        for polyline in polylines:
            polyline_path = getPolylinePath(polyline) + [getStartingPoint(polyline)]
            rhino_paths.append(rh.Geometry.Polyline([rh.Geometry.Point3d(point2D[0],point2D[1], 0) for point2D in polyline_path]))
Curve = rhino_paths
# ---------- end converts_svg_file_to_gh_curve ----------
pt_2 = Point(pt)
crv = Curve(converts_svg_file_to_gh_curve.Curve)
brec = BoundingRectangle(Geometry=crv, Plane=PlaneXY(0, 0, 0), Axis=0, Slide=0, Union=True)  # -> Bounding, DimensionX, DimensionY
pcen = PolygonCenter(Polyline=brec.Bounding)  # -> CenterV, CenterE, CenterA
vec2pt_2 = Vector2Pt(PointA=pcen.CenterV, PointB=pt_2, Unitize=False)  # -> Vector, Length
X = UnitX(Factor=1)
move_2 = Move(Geometry=crv, Motion=vec2pt_2.Vector)  # -> Geometry, Transform
base_plane = PlaneNormal(Origin=pt_2, ZAxis=get_normal)
align = AlignPlane(Plane=base_plane, Direction=X)  # -> Plane, Angle
deplane = DeconstructPlane(Plane=align.Plane)  # -> Origin, XAxis, YAxis, ZAxis
movetoplane = MoveToPlane(Geometry=move_2.Geometry, Plane=align.Plane, Above=False, Below=False)  # -> Geometry, Transform
axis_and_rotation_point = GhPythonScript(x=deplane.XAxis, y=deplane.YAxis, z=deplane.ZAxis)  # -> out, Angle, Axis
# ---------- axis_and_rotation_point: Python ----------
__author__ = "Ahmad"
__version__ = "2021.06.11"

import rhinoscriptsyntax as rs
import math
import Rhino as rh

class Vector3D(object):
    def __init__(self, x=0, y=0, z=0):
        self.X = x
        self.Y = y
        self.Z = z

    def cross(self, other):
        new_x = self.Y * other.Z - self.Z * other.Y
        new_y = -1 * (self.X * other.Z - self.Z * other.X)
        new_z = self.X * other.Y - self.Y * other.X
        return Vector3D(new_x, new_y, new_z)

    def dot(self, other):
        new_x = self.X * other.X
        new_y = self.Y * other.Y
        new_z = self.Z * other.Z
        return new_x + new_y + new_z

    def magnitude(self):
        return math.sqrt(self.X ** 2 + self.Y ** 2 + self.Z ** 2)

    def magnitude_square(self):
        return self.X ** 2 + self.Y ** 2 + self.Z ** 2

    def unit(self):
        mag = self.magnitude()
        new_x = self.X / mag
        new_y = self.Y / mag
        new_z = self.Z / mag
        return Vector3D(new_x, new_y, new_z)

    def __repr__(self):
        return "Vector3D({}, {}, {})".format(self.X, self.Y, self.Z)


CARTESIAN_METRIC = (Vector3D(1, 0, 0), Vector3D(0, 1, 0), Vector3D(0, 0, 1))


def get_axis_angle_rm(rotaion_matrix):
    """
    :param rotaion_matrix: 2D 3x3 array
    :return: (axis of rotation, angle)
    """
    [[a, b, c], [d, e, f], [g, h, i]] = rotaion_matrix
    rotation_axis = Vector3D(h - f, c - g, d - b)
    angle = math.acos(1 / 2 * (a + e + i - 1))
    return rotation_axis, angle


def get_axis_angle_lf(local_frame, global_frame=CARTESIAN_METRIC):
    return get_axis_angle_rm(get_Rotation(local_frame, global_frame))


def get_Rotation(local_frame, global_frame=CARTESIAN_METRIC):
    """
    :param gloabal_frame: Global axis defining tuple
    :param local_frame: local axis defining tuple
    :return: 2D array of values for Rotation
    """
    (x, y, z) = global_frame
    (x_prime, y_prime, z_prime) = local_frame
    sign_a = -1 if z.dot(x_prime.cross(y)) < 0 else 1
    sign_b = -1 if y.dot(z_prime.cross(x)) < 0 else 1
    sign_c = -1 if x.dot(y_prime.cross(z)) < 0 else 1

    cos_a = (1 / 2) * (x.cross(y_prime).magnitude() + sign_a * x_prime.cross(y).magnitude())
    cos_b = (1 / 2) * (z.cross(x_prime).magnitude() + sign_b * z_prime.cross(x).magnitude())
    cos_c = (1 / 2) * (y.cross(z_prime).magnitude() + sign_c * y_prime.cross(z).magnitude())
    
    sin_a = (1 / 2) * (y.dot(x_prime) - x.dot(y_prime))
    sin_b = (1 / 2) * (x.dot(z_prime) - z.dot(x_prime))
    sin_c = (1 / 2) * (z.dot(y_prime) - y.dot(z_prime))

    # rounding
    decimal_places = 3
    cos_a, cos_b, cos_c = round(cos_a, decimal_places), round(cos_b, decimal_places), round(cos_c, decimal_places)
    sin_a, sin_b, sin_c = round(sin_a, decimal_places), round(sin_b, decimal_places), round(sin_c, decimal_places)

    return [[cos_a * cos_b, cos_a * sin_b * sin_c - sin_a * cos_c, cos_a * sin_b * cos_c + sin_a * sin_c],
            [sin_a * cos_b, sin_a * sin_b * sin_c + cos_a * cos_c, sin_a * sin_b * cos_c - cos_a * sin_c],
            [-1 * sin_b, cos_b * sin_c, cos_b * cos_c]]


if __name__ == '__main__':
    x_prime = Vector3D(x.X, x.Y, x.Z).unit()
    y_prime = Vector3D(y.X, y.Y, y.Z).unit()
    z_prime = Vector3D(z.X, z.Y, z.Z).unit()
    local_frame = (x_prime, y_prime, z_prime)
    axis, angle = get_axis_angle_lf(local_frame)
    Axis = rh.Geometry.Vector3d(axis.X, axis.Y, axis.Z)
    Angle = angle
# ---------- end axis_and_rotation_point ----------
pl = PlaneNormal(Origin=pt_2, ZAxis=deplane.XAxis)
rot3d = Rotate3D(Geometry=movetoplane.Geometry, Angle=axis_and_rotation_point.Angle, Center=pt_2, Axis=axis_and_rotation_point.Axis)  # -> Geometry, Transform
scale = Scale(Geometry=rot3d.Geometry, Center=pt_2, Factor=scale_svg)  # -> Geometry, Transform
rotate = Rotate(Geometry=scale.Geometry, Angle=knob, Plane=align.Plane)  # -> Geometry, Transform
output_plane = Plane(align.Plane)
mirror = Mirror(Geometry=rotate.Geometry, Plane=pl)  # -> Geometry, Transform
vec = Vector(get_normal)
curve_to_project = Curve(mirror.Geometry)

brec_2 = BoundingRectangle(Geometry=curve_to_project, Plane=output_plane, Axis=0, Slide=0, Union=True)  # -> Bounding, DimensionX, DimensionY
vec_2 = Vector(expr("-x", vec))
rec = Rectangle(brec_2.Bounding)
python_3 = GhPythonScript(x=Slider(10, range=1..25))  # -> out, a
# ---------- python_3: Python ----------
__author__ = "Ahmad"
__version__ = "2021.07.07"

import rhinoscriptsyntax as rs
a = []
for i in range(int(x)):
    a.append((i + 1)/int(x))
print(a)
# ---------- end python_3 ----------
paramrecgrid = ParameterRectangleGrid(Rectangle=rec, ParametersX=python_3.a, ParametersY=python_3.a)  # -> Cells, Points
get_closest_projected_curve_to_point = GhPythonScript(Mesh=mesh_2, Crv=rec, Direction=vec_2, Pt=pt)  # -> out, projected_curve
# ---------- get_closest_projected_curve_to_point: Python ----------
__author__ = "Ahmad"
__version__ = "2021.06.29"

import rhinoscriptsyntax as rs
import Rhino as rh

projected_curves = rs.ProjectCurveToMesh(Crv, Mesh, Direction)
projected_curve = None
pt = rs.coerce3dpoint(Pt)
min_distance = rs.Distance(rs.coercecurve(projected_curves[-1]).PointAtStart, pt)
for i, crv in enumerate(projected_curves):
    distance = rs.Distance(pt, rs.coercecurve(crv).PointAtStart)
    print(distance, min_distance)
    if distance <= min_distance:
        projected_curve = projected_curves[i]
        min_distance = rs.Distance(pt, rs.coercecurve(crv).PointAtStart)
# ---------- end get_closest_projected_curve_to_point ----------
scale_2 = Scale(Geometry=vec_2, Center=Point(0, 0, 0), Factor=top_layer_thickness)  # -> Geometry, Transform
move_3 = Move(Geometry=get_closest_projected_curve_to_point.projected_curve, Motion=scale_2.Geometry)  # -> Geometry, Transform
project = ProjectPoint(Point=flatten(paramrecgrid.Points), Direction=vec_2, Geometry=mesh_2)  # -> Point, Index
crv_2 = Curve(move_3.Geometry)
move_4 = Move(Geometry=project.Point, Motion=scale_2.Geometry)  # -> Geometry, Transform
explode = Explode(Curve=crv_2, Recursive=True)  # -> Segments, Vertices
scale_3 = Scale(Geometry=vec_2, Center=Point(0, 0, 0), Factor=air_gap_thickness)  # -> Geometry, Transform
merge = Merge(Data1=move_4.Geometry, Data2=explode.Vertices)
patch = Patch(Curves=crv_2, Points=flatten(merge), Spans=20, Flexibility=1, Trim=True)
extr = Extrude(Base=patch, Direction=scale_3.Geometry)
subtract_enclosed_mesh = SubtractEnclosedMesh(mesh_a=mesh_2, M=extr)
ir_filament = Mesh(subtract_enclosed_mesh)

panel = Panel(rec)

normal_vector = UnitVector(Vector=get_normal)  # -> expr("-x", Vector)
crv_3 = Curve(curve_to_project)
explode_2 = Explode(Curve=crv_3, Recursive=True)  # -> Segments, Vertices
project_2 = ProjectPoint(Point=explode_2.Vertices, Direction=normal_vector, Geometry=mesh_2)  # -> Point, Index
num = Number([0, 1, 2, 3])
pt_3 = Point(simplify(project_2.Point))
item = ListItem(List=pt_3, Index=num, Wrap=True)
scale_4 = Scale(Geometry=normal_vector, Center=Point(0, 0, 0), Factor=air_gap_thickness)  # -> Geometry, Transform

scale_5 = Scale(Geometry=normal_vector, Center=Point(0, 0, 0), Factor=top_layer_thickness)  # -> Geometry, Transform

move_5 = Move(Geometry=item, Motion=scale_5.Geometry)  # -> Geometry, Transform
points_0 = ListItem(List=move_5.Geometry, Index=0, Wrap=True)
points_1 = ListItem(List=move_5.Geometry, Index=1, Wrap=True)
points_2 = ListItem(List=move_5.Geometry, Index=2, Wrap=True)
points_3 = ListItem(List=move_5.Geometry, Index=3, Wrap=True)
srf4pt = _4PointSurface(CornerA=points_0, CornerB=points_1, CornerC=points_2, CornerD=points_3)
extr_2 = Extrude(Base=srf4pt, Direction=scale_4.Geometry)
mjoin = MeshJoin(Meshes=flatten(extr_2))
mesh_to_subtract = Mesh(mjoin)

multi_material = Mesh(mesh_to_subtract)

bbox = BoundingBox(Content=ir_filament, Plane=PlaneXY(0, 0, 0))  # -> Box, Box_2
bbox_2 = BoundingBox(Content=multi_material, Plane=PlaneXY(0, 0, 0))  # -> Box, Box_2
boxprop = BoxProperties(Box=bbox.Box)  # -> Center, Diagonal, Area, Volume, Degeneracy
boxprop_2 = BoxProperties(Box=bbox_2.Box)  # -> Center, Diagonal, Area, Volume, Degeneracy
vec2pt_3 = Vector2Pt(PointA=boxprop.Center, PointB=boxprop_2.Center, Unitize=False)  # -> expr("Round(x,2)", Vector), Length
debox = DeconstructBox(Box=bbox_2.Box)  # -> Plane, X, Y, Z
centroid_coordinates = Panel(vec2pt_3.Vector)
debox_2 = DeconstructBox(Box=bbox.Box)  # -> Plane, X, Y, Z
get_slicer_coordinates = GhPythonScript(x=debox_2.X, y=debox_2.Y, z=debox_2.Z)  # -> out, slicer_center
# ---------- get_slicer_coordinates: Python ----------
__author__ = "Ahmad"
__version__ = "2021.07.07"

import rhinoscriptsyntax as rs
import Rhino as rh
import math
slicer_center = rh.Geometry.Point3d((x.Min + x.Max)/2 , (y.Min + y.Max)/2, z.Min)
# ---------- end get_slicer_coordinates ----------
get_slicer_coordinates_2 = GhPythonScript(x=debox.X, y=debox.Y, z=debox.Z)  # -> out, slicer_center; same code as get_slicer_coordinates
vec2pt_4 = Vector2Pt(PointA=get_slicer_coordinates.slicer_center, PointB=get_slicer_coordinates_2.slicer_center, Unitize=False)  # -> expr("Round(x,2)", Vector), Length
slicer_coordinates = Panel(vec2pt_4.Vector)

subtract_enclosed_mesh_2 = SubtractEnclosedMesh(mesh_a=mesh_2, M=mesh_to_subtract)
single_material = Mesh(subtract_enclosed_mesh_2)

# ==== cluster GetNormal
mesh = ClusterInput()
point = ClusterInput()
mesh_closest_point = MeshClosestPoint(Point=point, Mesh=mesh)  # -> Point_on_mesh, Index, Mesh_Parameter
demesh = DeconstructMesh(Mesh=mesh)  # -> Vertices, Faces, Colours, Normals
gets_list_item = ListItem(List=demesh.Faces, Index=mesh_closest_point.Index, Wrap=True)
deface = DeconstructFace(Face=gets_list_item)  # -> CornerA, CornerB, CornerC, CornerD
get_normal_closest_to_point = ListItem(List=demesh.Normals, Index=deface.CornerB, Wrap=True)
normal_vector = ClusterOutput(get_normal_closest_to_point)

# ==== cluster SubtractEnclosedMesh
M = ClusterInput()
mesh_a = ClusterInput()

rebmsh = RebuildMesh(
    Mesh=M,
    RebuildNormals=True,
    CullUnused=False,
    UnifyNormals=False,
    FlipNormals=True,
    IdenticalCombine=False,
    WeldVertices=0)
python = GhPythonScript(Mesh_A=mesh_a, Mesh_B=rebmsh)  # -> out, List_Mesh
# ---------- python: Python ----------
__author__ = "Ahmad"
__version__ = "2021.06.16"

import rhinoscriptsyntax as rs
A, B = rs.coercemesh(Mesh_A), rs.coercemesh(Mesh_B)
List_Mesh = [A, B]
# ---------- end python ----------
munion = MeshUnion(Meshes=python.List_Mesh)

R = ClusterOutput(munion)
